# Grasshopper definition Final Project part 2 bendy.gh (Grasshopper 1.0.8)

# ---- group: Bottom lid
rectangle = Rectangle(
    Plane=PlaneXY(0, 0, 0),
    XSize=Slider(166, range=0..1000),
    YSize=Slider(166, range=0..1000),
    Radius=Slider(50, range=0..100))  # -> Rectangle, Length

# ----
xy = XYPlane(Origin=Point(0, 0, 0))
xy_2 = XYPlane(Origin=Point(0, 0, 0))
xy_3 = XYPlane(Origin=Point(0, 0, 0))
xy_4 = XYPlane(Origin=Point(0, 0, 0))
polygon = Polygon(Plane=xy, Radius=Slider(20, range=0..100), Segments=Slider(3, range=0..10), FilletRadius=Slider(3, range=0..10))  # -> Polygon, Length
polygon_2 = Polygon(Plane=xy_2, Radius=Slider(20, range=0..100), Segments=Slider(3, range=0..10), FilletRadius=Slider(3, range=0..10))  # -> Polygon, Length
xy_5 = XYPlane(Origin=Point(0, 0, 0))
polygon_3 = Polygon(Plane=xy_3, Radius=Slider(20, range=0..100), Segments=Slider(3, range=0..10), FilletRadius=Slider(3, range=0..10))  # -> Polygon, Length
polygon_4 = Polygon(Plane=xy_4, Radius=Slider(20, range=0..100), Segments=Slider(3, range=0..10), FilletRadius=Slider(3, range=0..10))  # -> Polygon, Length

# ---- group: top lid
xy_6 = XYPlane(Origin=Point(0, 0, 0))
offset = OffsetCurve(Curve=rectangle.Rectangle, Distance=Slider(6, range=0..10), Plane=xy_6, Corners=1)

# ---- group: top lid lip
xy_7 = XYPlane(Origin=Point(0, 0, 0))
xy_8 = XYPlane(Origin=Point(0, 0, 0))
offset_2 = OffsetCurve(Curve=rectangle.Rectangle, Distance=Slider(-2, range=-10..-2), Plane=xy_7, Corners=1)
offset_3 = OffsetCurve(Curve=rectangle.Rectangle, Distance=Slider(-6, range=-10..-3), Plane=xy_8, Corners=1)

# ----
rot3d = Rotate3D(Geometry=polygon_2.Polygon, Angle=degrees(Slider(90, range=0..100)), Center=Point(0, 0, 0), Axis=Vector(0, 0, 1))  # -> Geometry, Transform
pt = ConstructPoint(XCoordinate=0, YCoordinate=Slider(10, range=0..10), ZCoordinate=0)
rectangle_2 = Rectangle(Plane=xy_5, XSize=Slider(100, range=0..1000), YSize=Slider(580, range=0..1000), Radius=0)  # -> Rectangle, Length
rot3d_2 = Rotate3D(Geometry=polygon.Polygon, Angle=degrees(Slider(90, range=0..100)), Center=Point(0, 0, 0), Axis=Vector(0, 0, 1))  # -> Geometry, Transform
pt_2 = ConstructPoint(XCoordinate=Slider(100, range=0..100), YCoordinate=Slider(10, range=0..10), ZCoordinate=0)
rot3d_3 = Rotate3D(Geometry=polygon_3.Polygon, Angle=degrees(Slider(90, range=0..100)), Center=Point(0, 0, 0), Axis=Vector(0, 0, 1))  # -> Geometry, Transform
rot3d_4 = Rotate3D(Geometry=polygon_4.Polygon, Angle=degrees(Slider(90, range=0..100)), Center=Point(0, 0, 0), Axis=Vector(0, 0, 1))  # -> Geometry, Transform
pt_3 = ConstructPoint(XCoordinate=Slider(25, range=0..100), YCoordinate=Slider(580, range=0..1000), ZCoordinate=0)
pt_4 = ConstructPoint(XCoordinate=Slider(25, range=0..100), YCoordinate=Slider(10, range=0..1000), ZCoordinate=0)
move = Move(Geometry=rot3d.Geometry, Motion=pt_4)  # -> Geometry, Transform
pt_5 = ConstructPoint(XCoordinate=Slider(75, range=0..100), YCoordinate=Slider(580, range=0..1000), ZCoordinate=0)
pt_6 = ConstructPoint(XCoordinate=Slider(75, range=0..100), YCoordinate=Slider(10, range=0..1000), ZCoordinate=0)
bbox = BoundingBox(Content=rectangle_2.Rectangle, Plane=PlaneXY(0, 0, 0))  # -> Box, Box_2
ln = Line(StartPoint=pt_2, EndPoint=pt)
move_2 = Move(Geometry=rot3d_3.Geometry, Motion=pt_5)  # -> Geometry, Transform
move_3 = Move(Geometry=rot3d_2.Geometry, Motion=pt_3)  # -> Geometry, Transform
move_4 = Move(Geometry=rot3d_4.Geometry, Motion=pt_6)  # -> Geometry, Transform
debox = DeconstructBox(Box=bbox.Box)  # -> Plane, X, Y, Z
dedomain = DeconstructDomain(Domain=debox.X)  # -> Start, End
series = Series(Start=Slider(455, range=0..1000), Step=Slider(6, range=0..10), Count=Slider(15, range=0..100))
series_2 = Series(Start=Slider(165, range=0..1000), Step=Slider(6, range=0..10), Count=Slider(15, range=0..100))
series_3 = Series(Start=Slider(310, range=0..1000), Step=Slider(6, range=0..10), Count=Slider(15, range=0..100))
series_4 = Series(Start=Slider(20, range=0..100), Step=Slider(6, range=0..10), Count=Slider(15, range=0..100))
series_5 = Series(Start=Slider(458, range=0..1000), Step=Slider(6, range=0..10), Count=Slider(15, range=0..100))
series_6 = Series(Start=Slider(313, range=0..1000), Step=Slider(6, range=0..10), Count=Slider(15, range=0..100))
series_7 = Series(Start=Slider(168, range=0..1000), Step=Slider(6, range=0..10), Count=Slider(15, range=0..100))
series_8 = Series(Start=Slider(23, range=0..100), Step=Slider(6, range=0..10), Count=Slider(15, range=0..100))
addition = Addition(A=dedomain.Start, B=Slider(15, range=0..100))
subtraction = Subtraction(A=dedomain.End, B=Slider(15, range=0..100))
subtraction_2 = Subtraction(A=dedomain.End, B=Slider(40, range=0..100))
subtraction_3 = Subtraction(A=dedomain.End, B=Slider(0, range=0..100))
addition_2 = Addition(A=dedomain.Start, B=Slider(0, range=0..100))
addition_3 = Addition(A=dedomain.Start, B=Slider(40, range=0..100))
pt_7 = ConstructPoint(XCoordinate=addition, YCoordinate=[series_4, series_2, series_3, series], ZCoordinate=0)
pt_8 = ConstructPoint(XCoordinate=subtraction, YCoordinate=[series_4, series_2, series_3, series], ZCoordinate=0)
pt_9 = ConstructPoint(XCoordinate=subtraction_2, YCoordinate=[series_8, series_7, series_6, series_5], ZCoordinate=0)
pt_10 = ConstructPoint(XCoordinate=subtraction_3, YCoordinate=[series_8, series_7, series_6, series_5], ZCoordinate=0)
pt_11 = ConstructPoint(XCoordinate=addition_2, YCoordinate=[series_8, series_7, series_6, series_5], ZCoordinate=0)
pt_12 = ConstructPoint(XCoordinate=addition_3, YCoordinate=[series_8, series_7, series_6, series_5], ZCoordinate=0)
ln_2 = Line(StartPoint=pt_7, EndPoint=pt_8)
ln_3 = Line(StartPoint=pt_10, EndPoint=pt_9)
ln_4 = Line(StartPoint=pt_11, EndPoint=pt_12)
