# Grasshopper definition Final Project 1.gh (Grasshopper 1.0.8)

# ---- group: One curve from points
number_slider = Slider(24, range=0..50)
subtraction = Subtraction(A=number_slider, B=Slider(1, range=0..10))
series = Series(Start=0, Step=Slider(7, range=0..10), Count=number_slider)
range = Range(Domain=Domain(0, 1), Steps=subtraction)
graph = GraphMapper(
    reverse(range),
    x0=0,
    x1=1,
    y0=0,
    y1=10,
    container_name="Sine",
    Equation_px=[0.9963427782, 0.5605495572],
    Equation_py=[0, 0.4852980375])
multiplication = Multiplication(A=graph, B=Slider(3, range=0..10))
pt = ConstructPoint(XCoordinate=series, YCoordinate=multiplication, ZCoordinate=0)

# ---- group: Base plate
pt_2 = ConstructPoint(XCoordinate=0, YCoordinate=0, ZCoordinate=0)
cir = Circle(Plane=pt_2, Radius=Slider(150, range=0..1000))
Z = UnitZ(Factor=Slider(2, range=0..10))
extr = Extrude(Base=cir, Direction=Z)
cap = CapHoles(Brep=extr)

# ---- group: Base notches and rotate them
pt_3 = ConstructPoint(XCoordinate=Slider(-1, range=-1..0), YCoordinate=Slider(147, range=0..1000), ZCoordinate=0)
xy = XYPlane(Origin=pt_3)
rectangle = Rectangle(Plane=xy, XSize=Slider(4.9, range=0..10), YSize=Slider(10, range=0..10), Radius=0)  # -> Rectangle, Length
xy_2 = XYPlane(Origin=Point(0, 0, 0))
rotate = Rotate(Geometry=rectangle.Rectangle, Angle=degrees(Slider(30, range=0..100)), Plane=xy_2)  # -> Geometry, Transform
pt_4 = ConstructPoint(XCoordinate=Slider(9, range=0..100), YCoordinate=0, ZCoordinate=0)
move = Move(Geometry=rotate.Geometry, Motion=pt_4)  # -> Geometry, Transform
arrcurve = CurveArray(Geometry=move.Geometry, Curve=cir, Count=Slider(24, range=0..100))  # -> Geometry, Transform

# ---- group: Line from curve
pline = PolyLine(Vertices=pt, Closed=False)
smoothpline = SmoothPolyline(Polyline=pline, Strength=1, Times=1)
crv = Curve(smoothpline)

# ---- group: Decreasing spiral
neg = Negative(Value=Slider(5, range=0..10))
series_2 = Series(Start=0, Step=neg, Count=number_slider)
ext = ExtendCurve(Curve=crv, Type=0, Start=range, End=series_2)

# ---- group: Cut out notch
pt_5 = ConstructPoint(XCoordinate=Slider(10, range=0..10), YCoordinate=0, ZCoordinate=0)
xy_3 = XYPlane(Origin=pt_5)
rectangle_2 = Rectangle(Plane=xy_3, XSize=Slider(4.9, range=0..10), YSize=Slider(6, range=0..10), Radius=0)  # -> Rectangle, Length

# ---- group: Make solid
brep = Brep(arrcurve.Geometry)
Z_2 = UnitZ(Factor=Slider(5, range=0..10))
extr_2 = Extrude(Base=brep, Direction=Z_2)

# ----
number_slider_2 = Slider(15, range=0..100)

# ---- group: Make lines from the first and space them
number_slider_3 = Slider(24, range=0..100)
series_3 = Series(Start=0, Step=number_slider_2, Count=number_slider_3)
Y = UnitY(Factor=series_3)
move_2 = Move(Geometry=ext, Motion=Y)  # -> Geometry, Transform

# ---- group: Make more and move them
series_4 = Series(Start=0, Step=number_slider_2, Count=number_slider_3)
Y_2 = UnitY(Factor=series_4)
move_3 = Move(Geometry=rectangle_2.Rectangle, Motion=Y_2)  # -> Geometry, Transform

# ---- group: Width of peice
Y_3 = UnitY(Factor=Slider(10, range=0..10))
extr_3 = Extrude(Base=move_2.Geometry, Direction=Y_3)

# ----
sdiff_combine_notch_and_base = SolidDifference(BrepsA=cap, BrepsB=extr_2)
panel = Panel(move_2.Geometry)
cls = Closed(Curve=move_2.Geometry)  # -> Closed, Periodic

# ---- group: Make solid
brep_2 = Brep(move_3.Geometry)
Z_3 = UnitZ(Factor=1)
extr_4 = Extrude(Base=brep_2, Direction=Z_3)

# ----
xy_4 = XYPlane(Origin=Point(0, 0, 0))
panel_2 = Panel(cls.Closed)
fillet_curve_corners = Fillet(Curve=extr_3, Radius=Slider(2, range=0..10))
contour = Contour(Shape=sdiff_combine_notch_and_base, Point=xy_4, Direction=Vector(0, 0, 1), Distance=Slider(3, range=0..10))

# ---- group: Make solid
brep_3 = Brep(fillet_curve_corners)
Z_4 = UnitZ(Factor=1)
extr_5 = Extrude(Base=brep_3, Direction=Z_4)

# ----
sdiff_combine_curve_and_notch = SolidDifference(BrepsA=extr_5, BrepsB=extr_4)
xy_5 = XYPlane(Origin=Point(0, 0, 0))
contour_2 = Contour(Shape=sdiff_combine_curve_and_notch, Point=xy_5, Direction=Vector(0, 0, 1), Distance=Slider(3, range=0..10))
