# Grasshopper definition L3-3DPSlicerGcodeGeneratorBase.gh (Grasshopper 1.0.8)
# plug-ins: RhinoCodePluginGH, BullAnt, Pancake

# ---- group: Cylinder
# [TODO]: Create Test Cylinder and Move to center of Bed
number_slider = Slider(10, range=0..20)
number_slider_2 = Slider(105, range=0..300)
Z = UnitZ(Factor=Slider(1.5, range=0..1.5))
cir = Circle(Plane=PlaneXY(0, 0, 0), Radius=number_slider)
extr = Extrude(Base=cir, Direction=Z)
cap = CapHoles(Brep=extr)
vec = VectorXYZ(XComponent=number_slider_2, YComponent=number_slider_2, ZComponent=0)  # -> Vector, Length
move = Move(Geometry=cap, Motion=vec.Vector)  # -> Geometry, Transform

# ----
# [TODO]: Create Contours / Perimeters)
brep = Brep(move.Geometry)
pt = ConstructPoint(XCoordinate=0, YCoordinate=0, ZCoordinate=Slider(0.15, range=0..1))
Z_2 = UnitZ(Factor=1)
contour = Contour(Shape=brep, Point=pt, Direction=Z_2, Distance=Slider(0.3, range=0..1.2))
boundary = BoundarySurfaces(Edges=contour)
debox = DeconstructBox(Box=boundary)  # -> Plane, X, Y, Z

# ---- group: Infill
extrusion_width = Slider(0.48, range=0..1)
dedomain = DeconstructDomain(Domain=debox.Y)  # -> Start, End
# [TODO]: Create Infill Patterns
dedomain_2 = DeconstructDomain(Domain=debox.X)  # -> Start, End
dedomain_3 = DeconstructDomain(Domain=debox.Z)  # -> Start, End
subtraction = Subtraction(A=dedomain_2.End, B=dedomain_2.Start)
division = Division(A=subtraction, B=extrusion_width)
series = Series(Start=dedomain_2.Start, Step=extrusion_width, Count=division)
pt_2 = ConstructPoint(XCoordinate=series, YCoordinate=dedomain.Start, ZCoordinate=dedomain_3.End)
pt_3 = ConstructPoint(XCoordinate=series, YCoordinate=dedomain.End, ZCoordinate=dedomain_3.End)
ln = Line(StartPoint=pt_2, EndPoint=pt_3)

# ---- group: early version of a Contor infill solution
area = Area()  # -> Area, Centroid
X = UnitX(Factor=1)
contour_2 = Contour(Point=area.Centroid, Direction=X, Distance=Slider(0.48, range=0..1))

# ----
# [TODO]: Combine Perimeters and Infill
blx = BrepLine(Brep=contour, Line=ln, LimitToFirst=False)  # -> Curves, Points
trim = TrimTree(Tree=blx.Curves, Depth=1)  # -> graft(Tree)
merge = Merge(Data1=trim, Data2=contour)

# ----
# 0.01 redeces the issue of the infill lines not reaching the perimeter.
number_slider_3 = Slider(0.01, range=0..0.01)

number_slider_4 = Slider(0.1, range=0..0.1)
# [TODO]: Create Line Segments from Perimeters and Infill
divlength = DivideLength(Curve=merge, Length=number_slider_3)  # -> Points, Tangents, Parameters
pline = PolyLine(Vertices=divlength.Points, Closed=False)
Z_3 = UnitZ(Factor=Slider(0.15, range=0..1))
ggspl = GgSimplifyPolyline(Polyline=pline, Tol=0.001)
move_2 = Move(Geometry=ggspl, Motion=Z_3)  # -> Geometry, Transform
explode = Explode(Curve=move_2.Geometry, Recursive=True)  # -> Segments, Vertices

# ---- group: A second line for testing
pt_4 = ConstructPoint(XCoordinate=Slider(10, range=-10..30), YCoordinate=Slider(10, range=-10..30), ZCoordinate=Slider(1, range=-10..30))
pt_5 = ConstructPoint(XCoordinate=Slider(10, range=-10..30), YCoordinate=Slider(20, range=-10..30), ZCoordinate=Slider(1, range=-10..30))
ln_2 = Line(StartPoint=pt_4, EndPoint=pt_5)

# ---- group: Example of a line for testing
# [TODO]: Use lines for testing gcode generation then replace with line segments from slicing
number_slider_5 = Slider(5, range=-10..30)
pt_6 = ConstructPoint(XCoordinate=number_slider_5, YCoordinate=Slider(1, range=-10..30), ZCoordinate=Slider(0, range=-10..30))
pt_7 = ConstructPoint(XCoordinate=Slider(30, range=-10..30), YCoordinate=Slider(1, range=-10..30), ZCoordinate=Slider(0, range=-10..30))
ln_3 = Line(StartPoint=pt_6, EndPoint=pt_7)

# ----
line = Line([ln_3, ln_2])
# [TODO]: Initialize Input Parameters
number_slider_6 = Slider(0.4, range=0..1)
# NOTE THAT THIS GCODE OUTPUT ASSUMES:
# - A PRUSA MK3S+ as the Printer
# - PLA Material
# - Extrusion Temperature: 215C
# - Heated Bed Temperature: 60C
travel_feed_rate = Panel("1200")
# [TODO]: Implement the gcode generation algorithm in Python
python_3_script_generate_gcode = Python3Script(
    lines=flatten(explode.Segments),
    nozzle_diameter=number_slider_6,
    filament_diameter=Slider(1.75, range=0..10),
    layer_height=Slider(0.3, range=0..1),
    extrusion_width=Slider(0.48, range=0..1),
    travel_feed_rate=travel_feed_rate,
    layer_change_feed_rate=Slider(720, range=0..1000),
    extrusion_feed_rate=Slider(600, range=0..1000))  # -> out, gcode_output; inputs lines: list of Line, nozzle_diameter: Double, filament_diameter: Double, layer_height: Double, extrusion_width: Double, travel_feed_rate: Double, layer_change_feed_rate: Double, extrusion_feed_rate: Double
# ---------- python_3_script_generate_gcode: Python ----------
"""
    This file contains parameters, helpers, and setup to 
    create a basic gcode generation algorithm from line segments.
    
    The main 
    
    Inputs:
        lines: the line segments to be converted into gcode commands for extrusion 
        nozzle_diameter: the diameter of the 3D printer's nozzle
        filament_diameter: the diameter of the 3d printing filament
        layer_height: the height of each layer in the print
        extrusion_width: the width of the extruded line from the printer
        travel_feed_rate: the speed at which the extruder moves in X and Y
        layer_change_feed_rate: the speed at which teh extruder moves when 
            changing layers in the Z direction
        extrusion_feed_rate: the speed at which the extruder move when extruding

    Output:
        gcode_output: a string with gcode commands separate by new-lines"""

__author__ = "mrivera-cu"

import rhinoscriptsyntax as rs

import math


########## CONSTANTS BELOW ###############

# GCODE COMMANDS
COMMAND_MOVE = "G1"

# GCODE PARAM NAMES
PARAM_X = "X"
PARAM_Y = "Y"
PARAM_Z = "Z"
PARAM_E = "E"
PARAM_F = "F"

# Separates commands
COMMAND_DELIMITER = "\n"

# Precision for converting floats to strings
E_VALUE_PRECISION = 5
XYZ_VALUE_PRECISION = 3

# Float equality precision
FLOAT_EQUALITY_PRECISION = 5

#### WARNING: DO NOT EDIT THE START GCODE! #####
start_gcode_lines = [";START GCODE",
    "M201 X1000 Y1000 Z200 E5000 ; sets maximum accelerations, mm/sec^2",
    "M203 X200 Y200 Z12 E120 ; sets maximum feedrates, mm / sec",
    "M204 S1250 T1250 ; sets acceleration (S) and retract acceleration (R), mm/sec^2",
    "M205 X8.00 Y8.00 Z0.40 E4.50 ; sets the jerk limits, mm/sec",
    "M205 S0 T0 ; sets the minimum extruding and travel feed rate, mm/sec",
    ";TYPE:Custom",
    "M862.3 P \"MK3S\" ; printer model check",
    "M862.1 P0.4 ; nozzle diameter check",
    "M115 U3.13.3 ; tell printer latest fw version",
    "G90 ; use absolute coordinates",
    "M83 ; extruder relative mode",
    "M104 S215 ; set extruder temp",
    "M140 S60 ; set bed temp",
    "M190 S60 ; wait for bed temp",
    "M109 S215 ; wait for extruder temp",
    "G28 W ; home all without mesh bed level",
    "G80 X86.6877 Y64.7708 W85.2412 H59.1573 ; mesh bed levelling",
    "G1 Z0.2 F720",
    "G1 Y-3 F1000 ; go outside print area",
    "G92 E0",
    "G1 X60 E9 F1000 ; intro line",
    "G1 X100 E12.5 F1000 ; intro line",
    "G92 E0",
    "M221 S95",
    "; Don't change E values below. Excessive value can damage the printer.",
    "M907 E538 ; set extruder motor current",
    "G21 ; set units to millimeters",
    "G90 ; use absolute coordinates",
    "M83 ; use relative distances for extrusion",
    "M900 K0.05 ; Filament gcode LA 1.5",
    "M900 K30 ; Filament gcode LA 1.0",
    "M107"]
    
##### WARNING: DO NOT EDIT THE END GCODE! ######
end_gcode_lines = ["; END Gcode", 
    "M204 S1000", 
    "M107", 
    ";TYPE:Custom", 
    "; Filament-specific end gcode", 
    "G1 Z180 F720 ; Move print head further up", 
    "G1 X0 Y200 F3600 ; park", 
    "G4 ; wait",
    "M221 S100 ; reset flow",
    "M900 K0 ; reset LA",
    "M104 S0 ; turn off temperature",
    "M140 S0 ; turn off heatbed",
    "M107 ; turn off fan",
    "M84 ; disable motors",
    "M73 P100 R0 ; print progress done",
    "M73 Q100 S0 ; print progress done"]

#########################################################################

# Converts a float (f) to a string with some precision of decimal places
# For example: 
# Input: f=0.1234, precision=3 
# Output: "0.123"
def float_to_string(f, precision=XYZ_VALUE_PRECISION): 
    f = float(f)
    str_format = "{value:." + str(precision) +"f}"
    return str_format.format(value=f)
    
# Helper to convert the E value to the proper precision
def e_value_to_string(e):
    return float_to_string(e, E_VALUE_PRECISION)

# Helper to convert the XYZ value to the proper precision
def xyz_value_to_string(e):
    return float_to_string(e, XYZ_VALUE_PRECISION)

#########################################################################

# Helper function to compare floats in grasshopper/python due to float precision errors
def are_floats_equal(f1, f2, epsilon=10**(-FLOAT_EQUALITY_PRECISION)):
    f1 *= 10**FLOAT_EQUALITY_PRECISION
    f2 *= 10**FLOAT_EQUALITY_PRECISION
    return math.fabs(f2 - f1) <= epsilon
    
# Helper function to compare if two points are equal (have the same coordinates)
# by handling float precision comparisons
def is_same_pt(ptA, ptB):
    return are_floats_equal(ptA[0], ptB[0]) and are_floats_equal(ptA[1], ptB[1]) and are_floats_equal(ptA[2], ptB[2])
     
     
########################################################################
# creates a string consisting of a G1 move command and 
# any associated parameters
def gcode_move(current_pos, next_pos, feed_rate=None, should_extrude=False):
    # Start with "G1" as command
    move_command_str = COMMAND_MOVE
    
    # Compare X positions
    if (not are_floats_equal(current_pos[0],next_pos[0])):
        # we have a different x position so add it as a parameter to the command
        x_value = float_to_string(next_pos[0], precision=XYZ_VALUE_PRECISION)
        # Add X<x_value> to move string, e.g., X100.00
        move_command_str += " " + PARAM_X + x_value
    
    # Compare Y positions
    if (not are_floats_equal(current_pos[1], next_pos[1])):
        # we have a different y position so add the new position as a parameter
        y_value = float_to_string(next_pos[1], precision=XYZ_VALUE_PRECISION)
        # Add Y<y_value> to move string, e.g., Y100.00
        move_command_str += " " + PARAM_Y + y_value
    
    # Compare Z position
    if (not are_floats_equal(current_pos[2], next_pos[2])):
        # we have a different z position so add the new position as a parameter
        z_value = float_to_string(next_pos[2], precision=XYZ_VALUE_PRECISION)
        # Add Z<z_value> to move string, e.g., Z100.00
        move_command_str += " " + PARAM_Z + z_value
    
    # [TODO]: handle "should_extrude" == true by determining the proper amount to
    # extrude using the capsule model, then append the E parameter and value
    # to the move command.
    # NOTE: YOUR FLOAT PRECISION MUST MATCH E_VALUE_PRECISION
 #____My stuff__    
    # useful from slides 
    #Lout = sqrt((x1 - x0)2 + (y1 - y0)2 + (z1 - z0)2)
    #Aout = Arect + Acircle
    #Arect = h * (w - h)
    #Acircle = π * r2 = π * (h/2)2
    #LE = (Aout * Lout) / (π * (Dfillament/2)**2)

    if (should_extrude):
	    segment_dist = math.sqrt((next_pos[0] - current_pos[0])**2 + (next_pos[1] - current_pos[1])**2 + (next_pos[2] - current_pos[2])**2)
	    area_circle = math.pi * (layer_height/ 2)**2
	    area_rectangle = layer_height * (extrusion_width - layer_height)
	    volume = (area_circle + area_rectangle) * segment_dist
	    filament_segment_length = volume / (math.pi * (filament_diameter/2)**2)
	    move_command_str += " " + PARAM_E + e_value_to_string(filament_segment_length)
    #________________
    
    
    # See if we have a feedrate to use, and handle it differently than other 
    # parameters as it is an integer value
    if (feed_rate is not None):
        # feed rate is an int
        feed_rate_value = round(feed_rate)
        # Add F<feed_rate_value> to move string, e.g., F2000
        move_command_str += " " + PARAM_F + str(feed_rate_value)   
    
    # Remove excess whitespace on ends
    move_command_str = move_command_str.strip(" ")
    return move_command_str


############################################
############################################
############################################
    
''' Here's the main method of the script that uses the helper methods above '''

def generate_gcode():

    # [TODO]: Implement the algorithm to generate gcode for each layer by 
    # first to moveing to the layer height, then moving to each line segment.
    # Once at a line segment, you should move and extrude along it, 
    # then move (travel) to the next line until there are no lines left
    # For each of these movements, you should append the command to
    # the list: `all_move_commands`
    current_position = [0, 0, 0]        # start extruder at the origin
    all_move_commands = []              # list to hold for all the move commands

    for i in range(0, len(lines)):
        # Get pts of the line segment
        line = lines[i]
        line_start_position = line.From
        line_end_position = line.To
        
        # [TODO]: Handle moving to the next layer (Z Position)
        # NOTE- ALL Z MOVEMENTS SHOULD:
        # 1) BE INDEPENDENT MOVES(e.g., G1 Z# and not move with other positions like XYE) 
        # 2) USE THE `layer_change_feedrate`
        # 3) BE IN INCREASING ORDER
#______My stuff______
        if not are_floats_equal(current_position[2], line_start_position[2]): 
            new_move = [current_position[0], current_position[1], line_start_position[2]]
            layer_move_up = gcode_move(current_position, new_move, feed_rate = layer_change_feed_rate, should_extrude=False)
            all_move_commands.append(layer_move_up) 
            #update z value 
            current_position[2] = line_start_position[2]

        if not is_same_pt(ptA = current_position, ptB = line_start_position):
            new_line = gcode_move(current_position, line_start_position, feed_rate = travel_feed_rate, should_extrude=False )
            all_move_commands.append(new_line)
            current_position = line_start_position
#____________
        # Now if our current_position is not the start of our line segment
        # we need to move (travel) to the line segment's starting point
        if not is_same_pt(current_position, line_start_position):
            # [Move to the the line_start_position
            move_to_line_start_command = gcode_move(current_position, line_start_position, feed_rate=travel_feed_rate, should_extrude=False)
            # A ppend command
            all_move_commands.append(move_to_line_start_command)
            current_position = line_start_position
        	
        # [TODO]: Once our extruder is at the start of the line, create a 
        # command to move AND extrude along 
        # the line segment using `extrusion_feed_rate`
#______My stuff____       
        command = gcode_move(line_start_position, line_end_position, feed_rate = extrusion_feed_rate, should_extrude = True )
#___________________ 

        # [TODO]: Append the move command across the line segment 
#______My stuff____ 
        all_move_commands.append(command)
#_________________
        
        # [TODO]: Update the current position of our extruder to be at the end of the line
       
     #______My stuff____ 
        current_position = line_end_position
#_________________   
    # End of for-loop above -- now create the full set of commands


    # [TODO]: Once you have all of the move commands stored as a list in
    # `all_move_commands`, combine the `start_gcode`, `all_move_commands`, and `end_gcode`
    # into one list called `gcode_lines`   

#______My stuff____ 
    gcode_lines = [] 
    gcode_lines.extend(start_gcode_lines)
    gcode_lines.extend(all_move_commands)
    gcode_lines.extend(end_gcode_lines)
#____________________

    # --- DO NOT EDIT BELOW ----
    # The takes the combined gcode_lines list and creates a string containing each line
    # separated by a COMMAND_DELIMITER (the new-line character), and sets it 
    # to the `gcode_output`variable of this component
    output = COMMAND_DELIMITER.join(gcode_lines)
    
    return output
    
''' RUN THE MAIN FUNCITON ABOVE - DO NOT EDIT '''
# this sets the gcode commands to be the the `gcode_output` variable of this grasshopper component
gcode_output = generate_gcode()
# ---------- end python_3_script_generate_gcode ----------
the_gcode_output = Panel(python_3_script_generate_gcode.gcode_output)
debugging_panel = Panel(python_3_script_generate_gcode.out)

# ---- group: Export
truebutton = TrueOnlyButton(LastSaveLocalization="neutral,N")
# [TODO]: Use Pancake Plug-in to Export Gcode Output File as .gcode
panel = Panel("/Users/sophie/Downloads/Comp Fab/gcodeL3Test.gcode")
pcexporttxt = ExportTXT(
    Content=python_3_script_generate_gcode.gcode_output,
    FileLocation=panel,
    Overwrite=Toggle(True),
    Encoding="utf-8",
    Export=truebutton,
    LastSaveLocalization="neutral,N")
panel_2 = Panel(pcexporttxt)
