# Grasshopper definition Polygon Lamp Shade.gh (Grasshopper 1.0.8)

gene_pool = GenePool(Decimals=0, Maximum=100, Minimum=0, Value=[0, 5, 10, 15, 20, 25])
slice_thickness = Slider(2.98, range=0..24)
gene_pool_2 = GenePool(Decimals=0, Maximum=50, Minimum=0, Value=[15, 20, 15, 20, 15, 20])
Z = UnitZ(Factor=1)
construct_point = ConstructPoint(XCoordinate=0, YCoordinate=0, ZCoordinate=gene_pool)
Z_2 = UnitZ(Factor=slice_thickness)
gene_pool_3 = GenePool(Decimals=0, Maximum=90, Minimum=1, Value=[30, 1, 30, 1, 30, 1])
polygon = Polygon(Plane=construct_point, Radius=gene_pool_2, Segments=6, FilletRadius=0)  # -> Polygon, Length
number_slider = Slider(18, range=1..35)
rotate_3d = Rotate3D(Geometry=polygon.Polygon, Angle=degrees(gene_pool_3), Center=construct_point, Axis=Vector(0, 0, 1))  # -> Geometry, Transform
series = Series(Start=Slider(0, range=0..5), Step=Slider(1, range=0..5), Count=Slider(17, range=0..100))
size_in_between = Slider(72, range=0..100)
divide_curve = DivideCurve(Curve=rotate_3d.Geometry, Count=number_slider, Kinks=False)  # -> Points, Tangents, Parameters
division = Division(A=Slider(360, range=1..360), B=number_slider)
pt = Point(Point(0, 0, 0))
flip_matrix = FlipMatrix(Data=divide_curve.Points)
interpolate_t = InterpolateT(Vertices=flip_matrix, TangentStart=Vector(0, 0, 0), TangentEnd=Vector(0, 0, 0), KnotStyle=1)  # -> Curve, Length, Domain
Z_3 = UnitZ(Factor=1)
mirror = Mirror(Geometry=interpolate_t.Curve, Plane=PlaneYZ(0, 0, 0))  # -> flatten(Geometry), Transform
xy = XYPlane(Origin=Point(0, 0, 0))
loft = Loft(Curves=mirror.Geometry, Options={Adjust=False, Closed=True, LoftEnds=0, LoftSimp=0, LoftType=0, Rebuild=10, Refit=0.01})
brep = Brep(loft)
contour = Contour(Shape=brep, Point=Point(0, 0, 0), Direction=Z, Distance=slice_thickness)
extr = Extrude(Base=contour, Direction=Z_2)
area = Area(Geometry=contour)  # -> Area, flatten(Centroid)
cap = CapHoles(Brep=extr)
lng = ListLength(List=cap)  # -> flatten(Length)
ma = MassAddition(Input=lng)  # -> Result, PartialResults
series_2 = Series(Start=0, Step=size_in_between, Count=ma.Result)
X = UnitX(Factor=series_2)
move = Move(Geometry=pt, Motion=X)  # -> Geometry, Transform
orient = Orient(Geometry=simplify(flatten(contour)), Source=area.Centroid, Target=move.Geometry)  # -> simplify(flatten(Geometry)), Transform
offset = OffsetCurve(Curve=orient.Geometry, Distance=Slider(-10, range=-10..0), Plane=xy, Corners=1)  # -> flatten(Curve)
curvepoint = PointOnCurve(offset, parameter=0.5)
area_2 = Area(Geometry=offset)  # -> Area, Centroid
srf = Surface(offset)
ln = Line(StartPoint=curvepoint, EndPoint=area_2.Centroid)
vec = Vector(ln)
unit = UnitVector(Vector=vec)
multiplication = Multiplication(A=unit, B=Slider(5, range=0..10))
addition = Addition(A=multiplication, B=curvepoint)
ln_2 = Line(StartPoint=addition, EndPoint=curvepoint)
flip = Flip(Surface=srf)  # -> Surface, Result
textsrf = TextOnSurface(
    Text=series,
    Font="Sans Bold:no Italic:no",
    Height=Slider(2, range=0..5),
    Depth=0.4,
    BaseLine=ln_2,
    BaseSurface=flip.Surface)
brep_2 = Brep(textsrf)
contour_2 = Contour(Shape=brep_2, Point=Point(0, 0, 0), Direction=Z_3, Distance=Slider(1, range=0..1))
