# Grasshopper definition M3 tables.gh (Grasshopper 1.0.8)

# ---- group: Table top 2
xy = XYPlane(Origin=Point(0, 0, 0))
rectangle = Rectangle(Plane=xy, XSize=Slider(65, range=0..100), YSize=Slider(55, range=0..100), Radius=Slider(3, range=0..10))  # -> Rectangle, Length
srf = Surface(rectangle.Rectangle)
Z = UnitZ(Factor=1)
extr = Extrude(Base=srf, Direction=Z)

# ----
xy_2 = XYPlane(Origin=Point(0, 0, 0))
polygon = Polygon(Plane=PlaneXY(0, 0, 0), Radius=Slider(50, range=0..100), Segments=Slider(4, range=0..10), FilletRadius=0)  # -> Polygon, Length
rectangle_2 = Rectangle(Plane=xy_2, XSize=Slider(50, range=0..100), YSize=Slider(50, range=0..100), Radius=Slider(2, range=0..10))  # -> Rectangle, Length

# ---- group: Table top 1
pt = ConstructPoint(XCoordinate=0, YCoordinate=0, ZCoordinate=0)
cir = Circle(Plane=pt, Radius=Slider(45, range=0..100))
Z_2 = UnitZ(Factor=Slider(3, range=0..10))
cir_2 = Circle(Plane=PlaneXY(0, 0, 0), Radius=Slider(45, range=0..100))
move = Move(Geometry=cir_2, Motion=Z_2)  # -> Geometry, Transform
merge = Merge(Data1=cir, Data2=move.Geometry)
srf_2 = Surface(merge)
loft = Loft(Curves=srf_2, Options={Adjust=False, Closed=False, LoftEnds=0, LoftSimp=0, LoftType=0, Rebuild=10, Refit=0.01})
cap = CapHoles(Brep=loft)

# ----
srf_3 = Surface(polygon.Polygon)

# ---- group: Table base 1
genes = GenePool(Decimals=0, Maximum=100, Minimum=0, Value=[0, 8, 17, 24, 32])
pt_2 = ConstructPoint(XCoordinate=0, YCoordinate=0, ZCoordinate=genes)
cir_3 = Circle(Plane=pt_2, Radius=Slider(33, range=0..100))
genes_2 = GenePool(Decimals=0, Maximum=100, Minimum=0, Value=[0, 17, 34, 51, 69])
Z_3 = UnitZ(Factor=1)
rot3d = Rotate3D(Geometry=cir_3, Angle=degrees(genes_2), Center=Point(0, 0, 0), Axis=Z_3)  # -> Geometry, Transform
divide = DivideCurve(Curve=rot3d.Geometry, Count=Slider(28, range=0..100), Kinks=False)  # -> Points, Tangents, Parameters
flip = FlipMatrix(Data=divide.Points)
intcrv = Interpolate(Vertices=flip, Degree=3, Periodic=False, KnotStyle=1)  # -> flatten(Curve), Length, Domain
mirror = Mirror(Geometry=intcrv.Curve, Plane=PlaneYZ(0, 0, 0))  # -> Geometry, Transform
loft_2 = Loft(Curves=intcrv.Curve, Options={Adjust=False, Closed=True, LoftEnds=0, LoftSimp=0, LoftType=0, Rebuild=10, Refit=0.01})
srfsplit = SurfaceSplit(Surface=loft_2, Curves=[intcrv.Curve, mirror.Geometry])
area = Area(Geometry=srfsplit)  # -> Area, Centroid
crv = Curve(srfsplit)
scale = Scale(Geometry=crv, Center=area.Centroid, Factor=Slider(0.48, range=0..1))  # -> Geometry, Transform
srfsplit_2 = SurfaceSplit(Surface=loft_2, Curves=scale.Geometry)
cull_i = CullIndex(List=srfsplit_2, Indices=Slider(0, range=0..100), Wrap=True)
item = ListItem(List=srfsplit_2, Index=0, Wrap=True)

# ----
area_2 = Area(Geometry=srf_3)  # -> Area, Centroid
pop2d = Populate2D(Region=rectangle_2.Rectangle, Count=Slider(9, range=0..100), Seed=1)

# ---- group: Table base 2
pt_3 = ConstructPoint(XCoordinate=Slider(0, range=0..100), YCoordinate=Slider(0, range=0..100), ZCoordinate=Slider(0, range=0..100))
number_slider = Slider(20, range=0..100)
pt_4 = Point(pt_3)
X = UnitX(Factor=Slider(3, range=0..5))
arrlinear = LinearArray(Geometry=pt_4, Direction=X, Count=number_slider)  # -> Geometry, Transform
subtraction = Subtraction(A=number_slider, B="1")
subtraction_2 = Subtraction(A=number_slider, B="1")
subtraction_3 = Subtraction(A=number_slider, B="1")
range = Range(Domain=Domain(0, 1), Steps=subtraction)
range_2 = Range(Domain=Domain(0, 1), Steps=subtraction_2)
range_3 = Range(Domain=Domain(0, 1), Steps=subtraction_3)
Y = UnitY(Factor=Slider(25, range=0..100))
Y_2 = UnitY(Factor=Slider(1, range=0..100))
Y_3 = UnitY(Factor=Slider(50, range=0..100))
graph = GraphMapper(
    range,
    x0=0,
    x1=1,
    y0=0,
    y1=1,
    Ox=0.4933745861,
    Oy=0.3282130361,
    Px=0.7943831682,
    Py=0.9947315454,
    container_name="Parabola")
graph_2 = GraphMapper(range_2, x0=0, x1=1, y0=0, y1=1, Ox=0.50006634, Oy=0.3269874454, Px=0.8053748012, Py=1, container_name="Parabola")
move_2 = Move(Geometry=arrlinear.Geometry, Motion=Y)  # -> Geometry, Transform
move_3 = Move(Geometry=arrlinear.Geometry, Motion=Y_2)  # -> Geometry, Transform
move_4 = Move(Geometry=arrlinear.Geometry, Motion=Y_3)  # -> Geometry, Transform
graph_3 = GraphMapper(
    range_3,
    x0=0,
    x1=1,
    y0=0,
    y1=1,
    container_name="Sinc",
    Equation_X0=0.5200584531,
    Equation_X1=0.5883647799,
    Equation_Y0=1,
    Equation_Y1=0.8151966333)
multiplication = Multiplication(A=graph, B=Slider(15, range=0..15))
multiplication_2 = Multiplication(A=graph_2, B=Slider(15, range=0..15))
multiplication_3 = Multiplication(A=graph_3, B=Slider(10, range=0..10))
Z_4 = UnitZ(Factor=multiplication)
Z_5 = UnitZ(Factor=multiplication_2)
Z_6 = UnitZ(Factor=multiplication_3)
move_5 = Move(Geometry=move_3.Geometry, Motion=Z_4)  # -> Geometry, Transform
move_6 = Move(Geometry=move_4.Geometry, Motion=Z_5)  # -> Geometry, Transform
move_7 = Move(Geometry=move_2.Geometry, Motion=Z_6)  # -> Geometry, Transform
graft = GraftTree(Tree=move_5.Geometry, IncludeEmptyLists=True, IncludeNullItems=True)
graft_2 = GraftTree(Tree=move_6.Geometry, IncludeEmptyLists=True, IncludeNullItems=True)
graft_3 = GraftTree(Tree=move_7.Geometry, IncludeEmptyLists=True, IncludeNullItems=True)
intcrv_2 = Interpolate(Vertices=[graft, graft_3, graft_2], Degree=3, Periodic=False, KnotStyle=1)  # -> Curve, Length, Domain
loft_3 = Loft(
    Curves=flatten(intcrv_2.Curve),
    Options={Adjust=False, Closed=False, LoftEnds=0, LoftSimp=0, LoftType=0, Rebuild=10, Refit=0.01})
Z_7 = UnitZ(Factor=Slider(3, range=0..10))
extr_2 = Extrude(Base=loft_3, Direction=Z_7)

# ----
voronoi = Voronoi(Points=pop2d, Boundary=rectangle_2.Rectangle, BruteForceOverride=False)
Z_8 = UnitZ(Factor=Slider(25, range=0..100))
extr_3 = Extrude(Base=voronoi, Direction=Z_8)
